# Grasshopper definition 2026_FALL_ARCHVIZ1_CSG.gh (Grasshopper 1.0.7)

center_box = CenterBox(Base=PlaneXY(0, 0, 0), X=1, Y=1, Z=1)
number_slider = Slider(4.1, range=0..10)
area = Area(Geometry=center_box)  # -> Area, Centroid
sphere = Sphere(Base=center_box, Radius=Slider(1.25, range=0..10000))
rotate_axis = RotateAxis(Geometry=center_box, Angle=1.570796327, Axis=Line((0, 0, 0), (10, 0, 0)))  # -> Geometry, Transform
deconstruct_plane = DeconstructPlane(Plane=area.Centroid)  # -> Origin, XAxis, YAxis, ZAxis
center_box_2 = CenterBox(Base=PlaneXY(0, 0, 0), X=1, Y=1, Z=1)
division = Division(A=number_slider, B=2)
cylinder = Cylinder(Base=area.Centroid, Radius=0.5, Length=number_slider)
negative = Negative(Value=division)
area_2 = Area(Geometry=center_box_2)  # -> Area, Centroid
amplitude = Amplitude(Vector=deconstruct_plane.ZAxis, Amplitude=negative)
number_slider_2 = Slider(3, range=0..10)
deconstruct_plane_2 = DeconstructPlane(Plane=area_2.Centroid)  # -> Origin, XAxis, YAxis, ZAxis
move = Move(Geometry=cylinder, Motion=amplitude)  # -> Geometry, Transform
move_2 = Move(Geometry=cylinder, Motion=amplitude)  # -> Geometry, Transform
division_2 = Division(A=number_slider_2, B=2)
rotate_axis_2 = RotateAxis(Geometry=move_2.Geometry, Angle=1.570796327, Axis=Line((0, 0, 0), (10, 0, 0)))  # -> Geometry, Transform
negative_2 = Negative(Value=division_2)
amplitude_2 = Amplitude(Vector=deconstruct_plane_2.ZAxis, Amplitude=negative_2)
cylinder_2 = Cylinder(Base=area_2.Centroid, Radius=0.5, Length=number_slider_2)
move_3 = Move(Geometry=cylinder, Motion=amplitude)  # -> Geometry, Transform
rotate = Rotate(Geometry=rotate_axis_2.Geometry, Angle=1.570796327, Plane=PlaneXY(0, 0, 0))  # -> Geometry, Transform
rotate_axis_3 = RotateAxis(Geometry=move.Geometry, Angle=1.570796327, Axis=Line((0, 0, 0), (10, 0, 0)))  # -> Geometry, Transform
move_4 = Move(Geometry=cylinder_2, Motion=amplitude_2)  # -> Geometry, Transform
solid_difference = SolidDifference(BrepsA=sphere, BrepsB=rotate.Geometry)
rotate_axis_4 = RotateAxis(Geometry=move_4.Geometry, Angle=1.570796327, Axis=Line((0, 0, 0), (10, 0, 0)))  # -> Geometry, Transform
solid_difference_2 = SolidDifference(BrepsA=solid_difference, BrepsB=rotate_axis_3.Geometry)
move_5 = Move(Geometry=cylinder_2, Motion=amplitude_2)  # -> Geometry, Transform
rotate_axis_5 = RotateAxis(Geometry=move_4.Geometry, Angle=1.570796327, Axis=Line((0, 0, 0), (10, 0, 0)))  # -> Geometry, Transform
rotate_2 = Rotate(Geometry=rotate_axis_4.Geometry, Angle=1.570796327, Plane=PlaneXY(0, 0, 0))  # -> Geometry, Transform
sphere_2 = Sphere(Base=center_box_2, Radius=Slider(5.44, range=0..10))
solid_difference_3 = SolidDifference(BrepsA=solid_difference_2, BrepsB=move_3.Geometry)
solid_difference_4 = SolidDifference(BrepsA=sphere_2, BrepsB=move_5.Geometry)
solid_intersection = SolidIntersection(BrepsA=solid_difference_3, BrepsB=rotate_axis.Geometry)
solid_difference_5 = SolidDifference(BrepsA=solid_difference_4, BrepsB=rotate_axis_5.Geometry)

solid_difference_6 = SolidDifference(BrepsA=solid_difference_5, BrepsB=rotate_2.Geometry)
solid_intersection_2 = SolidIntersection(BrepsA=solid_difference_6, BrepsB=center_box_2)
